# Grasshopper definition 241014_Eto_calls_Webview.gh (Grasshopper 1.0.8)
# plug-ins: RhinoCodePluginGH

py3 = Python3Script(get_inputs=Toggle(False))  # -> out, a
# ---------- py3: Python ----------
import System
import Rhino
import Grasshopper
import rhinoscriptsyntax as rs
import Eto.Forms as forms
import Eto.Drawing as drawing
import scriptcontext as sc


class MyComponent(Grasshopper.Kernel.GH_ScriptInstance):
    def RunScript(self, get_inputs):
        # Custom Styling Parameters
        BUTTON_COLOR = drawing.Color.FromArgb(100, 200, 150)
        BUTTON_FONT = drawing.Font('Arial', 12, drawing.FontStyle.Bold)

        # Form definition
        class CustomForm(forms.Form):
            def __init__(self):
                super(CustomForm, self).__init__()  # Call the base class constructor
                self.Title = 'Grasshopper UI with Eto Forms'
                self.ClientSize = drawing.Size(300, 200)
                self.Padding = drawing.Padding(10)
                self.Resizable = False

                # Initialize UI components
                self.create_layout()
                self.set_center()

            def create_layout(self):
                # Create buttons with custom styling
                self.button_true = forms.Button()
                self.button_true.Text = 'Set True'
                self.button_true.BackgroundColor = BUTTON_COLOR
                self.button_true.Font = BUTTON_FONT
                self.button_true.Click += self.on_button_true_click

                self.button_false = forms.Button()
                self.button_false.Text = 'Set False'
                self.button_false.BackgroundColor = BUTTON_COLOR
                self.button_false.Font = BUTTON_FONT
                self.button_false.Click += self.on_button_false_click

                # Add buttons to the layout
                layout = forms.StackLayout()
                layout.Items.Add(forms.StackLayoutItem(self.button_true))
                layout.Items.Add(forms.StackLayoutItem(self.button_false))

                self.Content = layout

            def set_center(self):
                # Get the Rhino main window handle and set the form to appear at the center of the screen
                main_window = Rhino.UI.RhinoEtoApp.MainWindow
                screen_rect = main_window.Bounds
                self.Location = drawing.Point((screen_rect.Width - self.ClientSize.Width) // 2 + screen_rect.X,
                                              (screen_rect.Height - self.ClientSize.Height) // 2 + screen_rect.Y)

            def on_button_true_click(self, sender, e):
                # Set sticky variable 'panel_value' to True when button is clicked
                sc.sticky['panel_value'] = True
                self.schedule_recompute()

            def on_button_false_click(self, sender, e):
                # Set sticky variable 'panel_value' to False when button is clicked
                sc.sticky['panel_value'] = False
                self.schedule_recompute()

            def schedule_recompute(self):
                # Get the current Grasshopper document
                gh_doc = Grasshopper.Instances.ActiveCanvas.Document
                if gh_doc is not None:
                    # Schedule a solution to recompute the Python component
                    gh_doc.ScheduleSolution(1, lambda doc: ghenv.Component.ExpireSolution(False))

        # Run the UI within Rhino/Grasshopper based on a boolean variable
        if get_inputs:
            if 'form' not in sc.sticky or not isinstance(sc.sticky['form'], CustomForm) or not sc.sticky['form'].Visible:
                form = CustomForm()
                sc.sticky['form'] = form
                sc.sticky['form'].Show()  # Only show the form once when it is created

        # Ensure output 'a' is updated after running the UI
        value = sc.sticky.get('panel_value', None)
        return value
# ---------- end py3 ----------
path = FilePath("K:\2019\F-19-02_Ferney-Voltaire_Logements_Perraudin\3_AUTRES\B+G_Paramétrisation portiques équivalents\Modèle Rhino+GH\240903_Integrated\UI\EFM-UI\index.html")
py3_2 = Python3Script()  # -> out, a; disabled
# ---------- py3_2: Python ----------
import Rhino
import scriptcontext as sc
import rhinoscriptsyntax as rs

def get_surfaces():
    # Allow the user to select multiple surfaces
    go = Rhino.Input.Custom.GetObject()
    go.SetCommandPrompt("Select surfaces")
    go.GeometryFilter = Rhino.DocObjects.ObjectType.Surface
    go.EnablePreSelect(False, True)
    go.EnablePostSelect(True)
    go.GetMultiple(1, 0)  # Require at least one surface
    
    if go.CommandResult() != Rhino.Commands.Result.Success:
        return None
    
    # Collect selected surfaces
    surfaces = []
    for obj_ref in go.Objects():
        surface = obj_ref.Surface()
        if surface:
            surfaces.append(surface)
    
    return surfaces

# Call the function and assign the result to a Grasshopper output
surfaces = get_surfaces()

# Assign the selected surfaces to the Grasshopper output
if surfaces:
    a = surfaces
else:
    a = None
# ---------- end py3_2 ----------
py3_3 = Python3Script(get_inputs=Toggle(False), path=path)  # -> out, a, b
# ---------- py3_3: Python ----------
import System
import Rhino
import Grasshopper
import Eto.Forms as forms
import Eto.Drawing as drawing
import scriptcontext as sc

class Element:
    def __init__(self, name, geometries, thickness):
        self.name = name
        self.geometries = geometries
        self.thickness = thickness

class MyComponent(Grasshopper.Kernel.GH_ScriptInstance):
    def RunScript(self, get_inputs, path):
        # Define a standalone function to recompute Grasshopper solution
        def schedule_recompute():
                # Get the current Grasshopper document
                gh_doc = Grasshopper.Instances.ActiveCanvas.Document
                if gh_doc is not None:
                    # Schedule a solution to recompute the Python component
                    gh_doc.ScheduleSolution(1, lambda doc: ghenv.Component.ExpireSolution(False))

        # Define a function to select geometries from Rhino
        def get_surfaces():
            # Allow the user to select multiple surfaces
            go = Rhino.Input.Custom.GetObject()
            go.SetCommandPrompt("Select surfaces")
            go.GeometryFilter = Rhino.DocObjects.ObjectType.Surface
            go.EnablePreSelect(False, True)
            go.EnablePostSelect(True)
            go.GetMultiple(1, 0)  # Require at least one surface

            if go.CommandResult() != Rhino.Commands.Result.Success:
                return None

            # Collect selected surfaces
            surfaces = []
            for obj_ref in go.Objects():
                surface = obj_ref.Surface()
                if surface:
                    surfaces.append(surface)

            return surfaces

        # Define the WebView dialog class
        class WebviewSliderDialog(forms.Form):
            def __init__(self):
                super(WebviewSliderDialog, self).__init__()
                # Set up the WebView to load the HTML file
                self.Title = "Slider WebView"
                self.Padding = drawing.Padding(5)
                self.ClientSize = drawing.Size(400, 800)
                self.Resizable = True

                # Create the WebView control and load the local HTML file
                self.m_webview = forms.WebView()
                self.m_webview.Size = drawing.Size(400, 800)
                self.m_webview.Url = System.Uri(path)  # Update with actual path

                # Subscribe to the DocumentLoading event to intercept navigation
                self.m_webview.DocumentLoading += self.on_document_loading

                # Layout
                layout = forms.StackLayout()
                layout.Items.Add(forms.StackLayoutItem(self.m_webview, True))
                self.Content = layout
                self.set_center()

            # Get the Rhino main window handle and set the form to appear at the center of the screen
            def set_center(self):
                main_window = Rhino.UI.RhinoEtoApp.MainWindow
                screen_rect = main_window.Bounds
                print (screen_rect.X)
                self.Location = drawing.Point((screen_rect.Width - self.ClientSize.Width) // 2 + screen_rect.X,
                                              (screen_rect.Height - self.ClientSize.Height) // 2 + screen_rect.Y)

            def on_document_loading(self, sender, e):
                # Intercept custom scheme (e.g., "greenscenario")
                if e.Uri.Scheme == "sliderupdate":
                    e.Cancel = True  # Prevent actual navigation
                    value = e.Uri.Query.strip('?')  # Get the value from the query string
                    self.handle_slider(value)  

                if e.Uri.Scheme == "geometryupdate":
                    e.Cancel = True  # Prevent actual navigation
                    value = e.Uri.Query.strip('?')  # Get the value from the query string
                    self.handle_add_geo(value)


            def handle_slider(self, value):
                # Log the slider value to the Rhino command line or output panel
                sc.sticky["slider_value"] = float(value)
                schedule_recompute()

            def handle_add_geo(self, value):
                # Split the value to get name and thickness
                name, thickness = value.split(',')
                thickness = float(thickness)
                # Prompt user to select surfaces in Rhino
                surfaces = get_surfaces()
                if surfaces:
                    element = Element(name, surfaces, thickness)
                    sc.sticky["element"] = element
                    schedule_recompute()

        # Run the UI within Rhino/Grasshopper based on a boolean variable
        if get_inputs:
            
            if 'form' not in sc.sticky or not isinstance(sc.sticky['form'], WebviewSliderDialog) or not sc.sticky['form'].Visible:
                form = WebviewSliderDialog()
                sc.sticky['form'] = form
                sc.sticky['form'].Show()
                

        # Ensure output 'a' is updated after running the UI

        value = sc.sticky.get('slider_value', None)
        element = sc.sticky.get('element', None)
        return value, element.name
# ---------- end py3_3 ----------
panel = Panel(py3.a)
panel_2 = Panel(py3_3.out)
panel_3 = Panel([py3_3.a, py3_3.b])
